# Grasshopper definition Gorilla_Example_v01.gh (Grasshopper 1.0.7)
# plug-ins: UI_Grid_Selector

# ----
# This variant on the Merge node keeps the
#  input order and allows tree formatting.
panel = Panel("a label component")
omerge = OrderedMerge(Item0=panel, Item1="a dropdown component", Item2="a radio button")
panel_2 = Panel(omerge)

# ----
# Use with UI tools like Human UI where
#  the compiler node asks for columns
# and rows to place each unique element.
# Notice the order of your cells that
# represent UI grid positions, then plug in
# your UI components in the same order to
# the Ordered Merge node.
panel_3 = Panel("3")
gorillagrid = GorillaGrid(
    Cols=panel_3,
    Rows="5",
    Cell_0_Col=0,
    Cell_0_Row=0,
    Cell_1_Col=1,
    Cell_1_Row=3,
    Cell_2_Col=0,
    Cell_2_Row=1,
    Cell_3_Col=1,
    Cell_3_Row=1,
    Cell_4_Col=0,
    Cell_4_Row=2,
    Cell_5_Col=2,
    Cell_5_Row=4,
    Cell_6_Col=0,
    Cell_6_Row=4)  # -> SelectedCells, ColumnIndexes, RowIndexes, UnselectedCells
panel_4 = Panel(gorillagrid.SelectedCells)
